# Grasshopper definition parseResultsToJson.gh (Grasshopper 0.9.75)
# plug-ins: HDTReference

dir = DirectoryContents(FolderPath="C:\pollinate\Swarm", Filter="done.receipt", IncludeSubfolders=True)  # -> FilePaths, FileNames
file = ReadFile(File=dir.FilePaths, PerLineParse=True)
contains = ContainsAB(A=flatten(file), B="null")
dispatch = Dispatch(List=flatten(file), DispatchPattern=contains)  # -> ListA, ListB
join = TextJoin(Text=dispatch.ListB, Join=",")
format = Format(Format="[{0}]", Culture=127, Data0=join)
merge = Merge(Data1="[", Data2=join, Data3="]")
panel = Panel(format)

# ==== cluster ContainsAB: Tests if a string contains another string.
B = ClusterInput()
A = ClusterInput()
A_2 = String(A)
B_2 = String(B)
eval = Evaluate(F="Contains(x,y)", x=A_2, y=B_2)
c = Boolean(eval)
c_2 = ClusterOutput(c)
