# Grasshopper definition Create Command Line Instructions.gh (Grasshopper 0.9.75)
# plug-ins: HDTReference

panel = Panel("\"C:\\Program Files\\Rhinoceros 5 (64-bit)\\System\\Rhino.exe\" /runscript=\"-Grasshopper Editor Load Document Open \"\"{0}\"\" Enter\"")
dir = DirectoryContents(FolderPath="C:\testout", Filter="*.gh", IncludeSubfolders=False)  # -> FilePaths, FileNames
format = Format(Format="{0}.gh", Culture=127, Data0=dir.FileNames)
format_2 = Format(Format="{0}{1}", Culture=127, Data0="C:\srcData\", Data1=format)
format_3 = Format(Format=panel, Culture=127, Data0=format_2)
subset = SubList(List=format_3, Domain="10", Wrap=True)  # -> List, Index
panel_2 = Panel(subset.List)
