# Grasshopper definition DefMaster.gh (Grasshopper 0.9.75)
# plug-ins: Python Interpreter

update = Button()
c_script = CSharpScript(x=update)  # -> out, C, E, A
# ---------- c_script: C# ----------
    if(GrasshopperDocument.IsFilePathDefined){
      C = GrasshopperDocument.FilePath;

      System.IO.FileInfo info = new System.IO.FileInfo(GrasshopperDocument.FilePath);
      E = info.Name;
      A = info.DirectoryName;
    } else {
      C = "Unsaved Document";
    }
# ---------- end c_script ----------
format = Format(Format="{0}\launch.receipt", Culture=127, Data0=c_script.A)
writeresults = WriteResults(data="it launched dude", y=format)
southglzratio = Slider(0.7, range=0..1)
# Parameters
height = Slider(31, range=20..40)
taper = Slider(-0.6, range=-0.6..0.4)
ladybug = Ladybug_Ladybug()  # -> Vviiiiiiiiiizzz; plug-in component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
brep = Brep([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])
honeybee = Honeybee_Honeybee()  # -> Vviiiiiiiiiizzz; plug-in component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
crv = Curve([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])
lng = ListLength(List=writeresults)
format_2 = Format(Format="{0}\{1}", Culture=127, Data0=c_script.A, Data1="ParamSet.json")
preview = CustomPreview(Geometry=brep, Shader=ColourSwatch(SwatchColor=RGBA(186, 186, 186, 159)))
preview_2 = CustomPreview(Geometry=crv, Shader=ColourSwatch(SwatchColor=RGB(0, 0, 0)))
dispatch = Dispatch(List=format_2, DispatchPattern=lng)  # -> ListA, ListB
format_3 = Format(Format="{0}\done.receipt", Culture=127, Data0=c_script.A)
file = ReadFile(File=format_2, PerLineParse=True)
null = NullItem(Item=file)  # -> NullFlags, InvalidFlags, Description; disabled
c_script_2 = CSharpScript(x=null.NullFlags)  # -> out, A; inputs x: Boolean; disabled
# ---------- c_script_2: C# ----------
    if(x){
      System.Threading.Thread.Sleep(200);
      
    }
    A = x;
# ---------- end c_script_2 ----------
dispatch_2 = Dispatch(List=format_2, DispatchPattern=c_script_2.A)  # -> ListA, ListB; disabled
file_2 = ReadFile(File=dispatch_2.ListA, PerLineParse=True)  # disabled
readjson = PythonScript(x=file)  # -> out, a, b
# ---------- readjson: Python ----------
import json
dict = json.loads(x)
keys = []
vals = []
for key in dict:
     keys.append(key)
     vals.append(dict[key])
a = keys
b = vals
# ---------- end readjson ----------
merge = Merge(Data1=file, Data2=file_2)  # disabled
clean = CleanTree(Tree=flatten(merge), CleanInvalid=True, CleanEmpty=False)  # disabled
panel = Panel(readjson.a)
item = ListItem(List=readjson.b, Index=0, Wrap=True)  # -> Item, Item1, Item2
pt = Point(Point(11.44104369, 2.352967986, 0))
vec = Vector(Vector(-8.845523185, 4.599579565, 0))
southglzratio_2 = Number(item.Item)
taper_2 = Number(item.Item2)
height_2 = Number(item.Item1)
pow = Power(A="3", B=2)
multiplication = Multiplication(A=pow, B=height_2)
pl = ConstructPlane(Origin=pt, XAxis=vec, YAxis=Vector(0, 1, 0))
division = Division(A=1000, B=multiplication)
multiplication_2 = Multiplication(A="3", B=division)
neg = Negative(Value=multiplication_2)
rectangle = Rectangle(Plane=pl, XSize=multiplication_2, YSize=neg, Radius=0)  # -> Rectangle, Length
pt_2 = ConstructPoint(XCoordinate=0, YCoordinate=0, ZCoordinate=height_2)
area = Area(Geometry=rectangle.Rectangle)  # -> Area, Centroid
move = Move(Geometry=rectangle.Rectangle, Motion=pt_2)  # -> Geometry, Transform
addition = Addition(A=taper_2, B=1)
area_2 = Area(Geometry=move.Geometry)  # -> Area, Centroid
subtraction = Subtraction(A=1, B=taper_2)
scale = Scale(Geometry=move.Geometry, Center=area_2.Centroid, Factor=subtraction)  # -> Geometry, Transform
scale_2 = Scale(Geometry=rectangle.Rectangle, Center=area.Centroid, Factor=addition)  # -> Geometry, Transform
loft = Loft(
    Curves=[scale_2.Geometry, scale.Geometry],
    Options={Adjust=False, Closed=False, LoftEnds=0, LoftSimp=0, LoftType=0, Rebuild=10, Refit=0.01})
cap = CapHoles(Brep=loft)
bbox = BoundingBox(Content=cap, Plane=PlaneXY(0, 0, 0))  # -> Box, Box_2
panel_2 = Panel("@3")  # disabled
panel_3 = Panel("@2")  # disabled
toggle = BooleanToggle(True)  # disabled
python = PythonScript(bldgMasses=cap, bldgsFlr2FloorHeights=panel_2, perimeterZoneDepth=panel_3, runIt=toggle)  # -> out, splitBldgMasses; disabled; plug-in component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
zbb = ZoomBoundingBox(box=bbox.Box, x="Perspective", run=Toggle(True))  # -> out, A; inputs box: Box, x: String, run: Boolean
# ---------- zbb: C# ----------
    if(run){
      RhinoDocument.Views.Find(x,false).ActiveViewport.ZoomBoundingBox(box.BoundingBox);
    }
# ---------- end zbb ----------
mass2zone = Honeybee_Masses2Zones(bldgMasses=flatten(cap), bldgsFlr2FlrHeights=flatten("@4"), maximumRoofAngle=30, createHoneybeeZones=Toggle(True))  # -> readMe, HBZones; plug-in component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
site = Brep([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])
glzparamlist = Honeybee_GlazingParametersList(northGlzRatio="0.4", westGlzRatio="0.4", southGlzRatio=southglzratio_2, eastGlzRatio="0.4")  # -> readMe, glzRatioList, windowHeightList, sillHeightList; plug-in component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
hb_epcontextsrf = HoneybeeEPContextSurfaces(shdSurfaces=flatten(site), justBoundingBox=Toggle(True))  # -> readMe, HBContext; inputs shdSurfaces: list of GeometryBase, EPtransSchedule: list
# ---------- hb_epcontextsrf: Python ----------
"""
prepare shading/context geometries

    Args:
        northVectorOrRotation: A vector that shows North or a number that shows
                               the rotation of the North from the Y axis
        bldgMasses: List of closed Breps as thermal zones.
    Returns:
        report: ...
        thermalZones: Thermal zone's geometries for visualiza
"""

ghenv.Component.Name = 'Honeybee EP context Surfaces'
ghenv.Component.NickName = 'HB_EPContextSrf'
ghenv.Component.Message = 'VER 0.0.53\nMAY_12_2014'
ghenv.Component.Category = "Honeybee"
ghenv.Component.SubCategory = "09 | Energy | Energy"
ghenv.Component.AdditionalHelpFromDocStrings = "1"

import rhinoscriptsyntax as rs
import Rhino as rc
import scriptcontext as sc
import os
import System
from clr import AddReference
AddReference('Grasshopper')
import Grasshopper.Kernel as gh

tolerance = sc.doc.ModelAbsoluteTolerance
import math


def main():
    # import the classes
    if sc.sticky.has_key('ladybug_release')and sc.sticky.has_key('honeybee_release'):
        
        # don't customize this part
        hb_EPSrf = sc.sticky["honeybee_EPSurface"]
        hb_EPSHDSurface = sc.sticky["honeybee_EPShdSurface"]

        ########################################################################
        #----------------------------------------------------------------------#
        shdBreps = []
        if justBoundingBox:
            for brep in shdSurfaces:
                if brep.Faces.Count>1 or not brep.Faces[0].IsPlanar(sc.doc.ModelAbsoluteTolerance):
                    shdBreps.append(brep.GetBoundingBox(True).ToBrep())
                else:
                    shdBreps.append(brep)
        else: shdBreps = shdSurfaces
        
        shadingClasses = []
        shadingMeshPreview = []
        if meshingLevel == 0:
            mp = rc.Geometry.MeshingParameters.Minimal
            mp.SimplePlanes = True
        elif 0.25 < meshingLevel <0.75:
            mp = rc.Geometry.MeshingParameters.Default
        else:
            mp = rc.Geometry.MeshingParameters.Smooth
        
        def getRadMaterialName(radMaterial):
            nameStr = radMaterial.split(" ")[2]
            name =  nameStr.split("\n")[0]
            return name
        
        for brepCount, brep in enumerate(shdBreps):
            if len(brep.DuplicateEdgeCurves(False))>1:
                meshedGeo = rc.Geometry.Mesh.CreateFromBrep(brep, mp)
                for brepFaceIndex in range(brep.Faces.Count):
                    mesh = meshedGeo[brepFaceIndex]
                    #for meshCount, mesh in enumerate(meshedGeo):
                    thisShading = hb_EPSHDSurface(brep.Faces[brepFaceIndex].ToBrep(), 1000*brepCount + brepFaceIndex, 'shdSrf_' + `brepCount` + '_' + `brepFaceIndex`)
                    for faceIndex in  range(mesh.Faces.Count):
                        thisShading.collectMeshFaces(mesh.Faces.GetFaceVertices(faceIndex))
                    if EPConstruction!=None: thisShading.EPConstruction = EPConstruction
                    if RADConstruction!=None: thisShading.RadMaterial = getRadMaterialName(RADConstruction)
                    shadingClasses.append(thisShading)
                    # shadingMeshPreview.append(thisShading.meshedFace)
                    brepFaceIndex += 1
        
        # add to the hive
        hb_hive = sc.sticky["honeybee_Hive"]()
        HBContext  = hb_hive.addToHoneybeeHive(shadingClasses, ghenv.Component.InstanceGuid.ToString())
        return HBContext
        ################################################################################################
    else:
        print "You should first let both Ladybug and Honeybee to fly..."
        w = gh.GH_RuntimeMessageLevel.Warning
        ghenv.Component.AddRuntimeMessage(w, "You should first let both Ladybug and Honeybee to fly...")
        return -1
        

if shdSurfaces and shdSurfaces[0]!=None:
    # add cleaning function
    result= main()
    
    if result != -1: HBContext = result
# ---------- end hb_epcontextsrf ----------
solveadjc = Honeybee_SolveAdjacencies(HBZones=flatten(mass2zone.HBZones), findAdjc=Toggle(True))  # -> readMe, HBZonesWADJ; plug-in component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
writeresultparameters = Honeybee_WriteEPResultParameters(zoneEnergyUse="True", zoneGainsAndLosses="False", zoneTemperatures="False", surfaceAnalysis="False", timestep="hourly")  # -> report, simulationOutputs; plug-in component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
number_slider = Slider(1, range=0..1)
item_2 = ListItem(List=hb_epcontextsrf.HBContext, Index=0, Wrap=True)
toggle_2 = BooleanToggle(True)
glazingcreator = Honeybee_GlazingBasedOnRatio(HBObjects=flatten(solveadjc.HBZonesWADJ), glzRatio=flatten(glzparamlist.glzRatioList), runIt=Toggle(True))  # -> readMe, HBObjWGLZ; plug-in component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
panel_4 = Panel(writeresultparameters.simulationOutputs)
rec = DataRecorder(item_2, DataLimit=-10, RecordData=True)
lng_2 = ListLength(List=rec)
analysisperiod = Ladybug_AnalysisPeriod(fromMonth=number_slider, toMonth=number_slider)  # -> readMe, analysisPeriod; plug-in component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
panel_5 = Panel("C:\EnergyPlusV8-1-0\WeatherData\USA_IL_Chicago-OHare.Intl.AP.725300_TMY3.epw")
ma = MassAddition(Input=lng_2)  # -> Result, PartialResults
decomposebytype = Honeybee_DecomposeBasedOnType(HBZone=flatten(glazingcreator.HBObjWGLZ))  # -> walls, windows, skylights, roofs, floors, ceilings, airWalls, shadings; plug-in component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
larger = LargerThan(FirstNumber=ma.Result, SecondNumber="1")  # -> LargerThan, OrEqualTo
and = GateAnd(A=toggle_2, B=larger.LargerThan)
pan = Panel("C:/Data/")
lng_3 = ListLength(List=flatten([decomposebytype.walls, decomposebytype.windows, decomposebytype.roofs, decomposebytype.floors]))
c_script_3 = CSharpScript(x=lng_3, z="Perspective")  # -> out, A; inputs z: String
# ---------- c_script_3: C# ----------
    List<object> os = new List<object>();
    Bitmap bmp = RhinoDocument.Views.Find(z,false).CaptureToBitmap(new Size(400, 400));
    A = Convert.ToBase64String(ImageToByte(bmp));
# ---------- c_script_3: C# additional code ----------
  public static byte[] ImageToByte(Image img)
  {
    ImageConverter converter = new ImageConverter();
    return (byte[]) converter.ConvertTo(img, typeof(byte[]));
  }
# ---------- end c_script_3 ----------
area_3 = Area(Geometry=decomposebytype.floors)  # -> Area, Centroid
area_4 = Area(Geometry=decomposebytype.roofs)  # -> Area, Centroid
area_5 = Area(Geometry=decomposebytype.windows)  # -> Area, Centroid
pan_2 = Panel("""wall area
window area
roof area
floor area
capture""")
area_6 = Area(Geometry=decomposebytype.walls)  # -> Area, Centroid
ma_2 = MassAddition(Input=flatten(area_3.Area))  # -> Result, PartialResults
ma_3 = MassAddition(Input=flatten(area_4.Area))  # -> Result, PartialResults
ma_4 = MassAddition(Input=flatten(area_5.Area))  # -> Result, PartialResults
ma_5 = MassAddition(Input=flatten(area_6.Area))  # -> Result, PartialResults
runenergysimulation = Honeybee_RunEnergySimulation(
    epwFile=panel_5,
    analysisPeriod=analysisperiod.analysisPeriod,
    HBZones=flatten(glazingcreator.HBObjWGLZ),
    HBContext=flatten(hb_epcontextsrf.HBContext),
    simulationOutputs=flatten(writeresultparameters.simulationOutputs),
    writeIdf=toggle_2,
    runEnergyPlus=Toggle(True),
    workingDir=c_script.A,
    idfFileName="oneMonthModel.idf",
    meshingLevel=1)  # -> report, idfFileAddress, resultFileAddress; plug-in component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
merge_2 = Merge(Data2=flatten("faceLength"), Data3="capture")
merge_3 = Merge(
    Data1=flatten(ma_5.Result),
    Data2=flatten(ma_4.Result),
    Data3=flatten(ma_3.Result),
    Data4=flatten(ma_2.Result),
    Data5=flatten(c_script_3.A))
preview_3 = CustomPreview(Geometry=decomposebytype.walls, Shader=ColourSwatch(SwatchColor=RGBA(255, 255, 120, 226)))
preview_4 = CustomPreview(Geometry=decomposebytype.windows, Shader=ColourSwatch(SwatchColor=RGBA(120, 226, 255, 116)))
preview_5 = CustomPreview(Geometry=decomposebytype.roofs, Shader=ColourSwatch(SwatchColor=RGBA(89, 89, 89, 226)))
preview_6 = CustomPreview(Geometry=decomposebytype.floors, Shader=ColourSwatch(SwatchColor=RGBA(230, 129, 129, 226)))
mkdict = PythonScript(x=pan_2, y=merge_3)  # -> out, a, b; inputs x: list, y: list
# ---------- mkdict: Python ----------
import json
dict = {}
for i,j in zip(x,y):
    dict[i] = j
arrDict = [dict]
a = arrDict
b = json.dumps(dict)
# ---------- end mkdict ----------
readidf = Honeybee_ReadEPResult(resultFileAddress=runenergysimulation.resultFileAddress)  # -> report, port, simplify(zoneHeating), zoneCooling, zoneElectricLight, zoneElectricEquip, port_2, zonePeopleGains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; plug-in component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
lng_4 = ListLength(List=flatten(readidf.zoneHeating))
merge_4 = Merge(Data1=lng_4, Data2=c_script_3.A)
panel_6 = Panel(runenergysimulation.report)
zonecooling = QuickGraph(readidf.zoneCooling)
zoneheating = QuickGraph(readidf.zoneHeating)
writeresults_2 = WriteResults(x=merge_4, data=mkdict.b, y=format_3)

# ==== cluster WriteResults
y = ClusterInput()
x = ClusterInput()
data = ClusterInput()
writetexttofile = CSharpScript(x=x, data=data, y=y)  # -> out, A; inputs x: tree, data: list of String, y: String
# ---------- writetexttofile: C# ----------
    string folderPath = Path.GetDirectoryName(y);
    if(!System.IO.Directory.Exists(folderPath)){
      System.IO.Directory.CreateDirectory(folderPath);
    }
    using (System.IO.StreamWriter file = new System.IO.StreamWriter(y))
    {
      foreach (string line in data)
      {

        file.WriteLine(line);

      }
    }
# ---------- end writetexttofile ----------
A = ClusterOutput(writetexttofile.A)
