# Grasshopper definition DefMaster_MSR.gh (Grasshopper 0.9.72)
# plug-ins: Python Interpreter, HDTReference, HDTTreeUtils

update = Button()
c_script = CSharpScript(x=update)  # -> out, C, E, A
# ---------- c_script: C# ----------
    if(GrasshopperDocument.IsFilePathDefined){
      C = GrasshopperDocument.FilePath;

      System.IO.FileInfo info = new System.IO.FileInfo(GrasshopperDocument.FilePath);
      E = info.Name;
      A = info.DirectoryName;
    } else {
      C = "Unsaved Document";
    }
# ---------- end c_script ----------
format = Format(Format="{0}\{1}", Culture=127, Data0=c_script.A, Data1="ParamSet.json")
format_2 = Format(Format="{0}\launch.receipt", Culture=127, Data0=c_script.A)
writeresults = WriteResults(data="it launched dude", y=format_2)
format_3 = Format(Format="{0}\done.receipt", Culture=127, Data0=c_script.A)
file = ReadFile(File=format, PerLineParse=True)
readjson = PythonScript(x=file)  # -> out, a, b
# ---------- readjson: Python ----------
import json
dict = json.loads(x)
keys = []
vals = []
for key in dict:
     keys.append(key)
     vals.append(dict[key])
a = keys
b = vals
# ---------- end readjson ----------
panel = Panel(readjson.a)
item = ListItem(List=readjson.b, Index=0, Wrap=True)  # -> Item, Item1, Item2, Item3, Item4, Item5
number_slider = Slider(0.7, range=0..1)
eastshadingdepth = Slider(0.5, range=0..1)
southshadingdepth = Slider(1, range=0..2)
westshadingdepth = Slider(0.5, range=0..1)
# Parameters
height = Slider(20, range=20..30)
taper = Slider(0.2, range=-0.6..0.4)
ladybug = Ladybug_Ladybug()  # -> Vviiiiiiiiiizzz; plug-in component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
brep = Brep([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])
honeybee = Honeybee_Honeybee()  # -> Vviiiiiiiiiizzz; plug-in component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
crv = Curve([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])
preview = CustomPreview(Geometry=brep, Shader=ColourSwatch(SwatchColor=RGBA(186, 186, 186, 159)))
preview_2 = CustomPreview(Geometry=crv, Shader=ColourSwatch(SwatchColor=RGB(0, 0, 0)))
panel_2 = Panel("http://apps1.eere.energy.gov/buildings/energyplus/weatherdata/4_north_and_central_america_wmo_region_4/1_usa/USA_NY_New.York-J.F.Kennedy.Intl.AP.744860_TMY3.zip")
pt = Point(Point(11.44104369, 2.352967986, 0))
vec = Vector(Vector(-8.845523185, 4.599579565, 0))
pow = Power(A="5", B=2)
multiplication = Multiplication(A=pow, B=item.Item4)
pl = ConstructPlane(Origin=pt, XAxis=vec, YAxis=Vector(0, 1, 0))
division = Division(A=1000, B=multiplication)
multiplication_2 = Multiplication(A="5", B=division)
open_epw_stat = Ladybug_OpenEPWAndSTATWeatherFiles(weatherFileURL=panel_2)  # -> epwFile, statFile; plug-in component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
neg = Negative(Value=multiplication_2)
rectangle = Rectangle(Plane=pl, XSize=multiplication_2, YSize=neg, Radius=0)  # -> Rectangle, Length
pt_2 = ConstructPoint(XCoordinate=0, YCoordinate=0, ZCoordinate=item.Item4)
area = Area(Geometry=rectangle.Rectangle)  # -> Area, Centroid
move = Move(Geometry=rectangle.Rectangle, Motion=pt_2)  # -> Geometry, Transform
addition = Addition(A=item.Item5, B=1)
area_2 = Area(Geometry=move.Geometry)  # -> Area, Centroid
subtraction = Subtraction(A=1, B=item.Item5)
scale = Scale(Geometry=move.Geometry, Center=area_2.Centroid, Factor=subtraction)  # -> Geometry, Transform
scale_2 = Scale(Geometry=rectangle.Rectangle, Center=area.Centroid, Factor=addition)  # -> Geometry, Transform
importepw = Ladybug_ImportEpw(epwFile=open_epw_stat.epwFile)  # -> readMe, latitude, location, dryBulbTemperature, dewPointTemperature, relativeHumidity, windSpeed, windDirection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; plug-in component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
importstat = Ladybug_ImportStat(statFile=open_epw_stat.statFile)  # -> readMe, ashraeClimateZone, koppenClimateZone, port, heatingDesignTemp, coolingDesignTemp, port_2, extremeHotWeek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; plug-in component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
loft = Loft(
    Curves=[scale_2.Geometry, scale.Geometry],
    Options={Adjust=False, Closed=False, LoftEnds=0, LoftSimp=0, LoftType=0, Rebuild=10, Refit=0.01})
cap = CapHoles(Brep=loft)
selectandaveragedata = Ladybug_AverageData(annualHourlyData=importepw.relativeHumidity)  # -> readMe, selHourlyData, averagedDaily, averagedMonthly, avrMonthlyPerHour; plug-in component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
separatedata = Ladybug_SeparateData(inputList=selectandaveragedata.averagedMonthly)  # -> numbers, strings; plug-in component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
splitmass = Honeybee_SplitBuildingMass(bldgMasses=cap, bldgsFlr2FloorHeights="@4", perimeterZoneDepth="@2", runIt=Toggle(True))  # -> out, splitBldgMasses; plug-in component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
mass2zone = Honeybee_Masses2Zones(bldgMasses=flatten(splitmass.splitBldgMasses), maximumRoofAngle=30, createHoneybeeZones=Toggle(True))  # -> readMe, HBZones; plug-in component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
glzparamlist = Honeybee_GlazingParametersList(northGlzRatio="0.4", westGlzRatio="0.4", southGlzRatio=item.Item3, eastGlzRatio="0.4")  # -> readMe, glzRatioList, windowHeightList, sillHeightList; plug-in component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
solveadjc = Honeybee_SolveAdjacencies(HBZones=flatten(mass2zone.HBZones), altBC="Adiabatic", findAdjc=Toggle(True))  # -> readMe, HBZonesWADJ; plug-in component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
callfromepconstrlibrary = Honeybee_CallFromEPConstructionLibrary()  # -> EPMaterials, EPWindowMaterils, EPConstructios; plug-in component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
panel_3 = Panel("""WALL
ROOF
FLOOR
CEILING
WINDOW""")
graft = GraftTree(Tree=panel_3, IncludeEmptyLists=True, IncludeNullItems=True)
searchepconstruction = Honeybee_SearchEPConstruction(
    EPConstrList=callfromepconstrlibrary.EPConstructios,
    standard=Slider(0, range=0..100),
    climateZone=importstat.ashraeClimateZone,
    surfaceType=graft)  # -> EPSelectedConstr; plug-in component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
item_2 = ListItem(List=searchepconstruction, Index=0, Wrap=True)
glazingcreator = Honeybee_GlazingBasedOnRatio(
    HBObjects=flatten(solveadjc.HBZonesWADJ),
    glzRatio=flatten(glzparamlist.glzRatioList),
    breakUpWindow=Toggle(False),
    runIt=Toggle(True))  # -> readMe, HBObjWGLZ; plug-in component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
bang = ExplodeTree(Data=simplify(item_2))  # -> Branch0, Branch1, Branch2, Branch3, Branch4
setepzonecnstr = Honeybee_SetEPZoneConstruction(
    HBZone=glazingcreator.HBObjWGLZ,
    wallEPConstruction=bang.Branch0,
    windowEPConstruction=bang.Branch4,
    roofEPConstruction=bang.Branch1,
    floorEPConstruction=bang.Branch2)  # -> simplify(flatten(modifiedHBZone)); plug-in component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
toggle = BooleanToggle(False)
shdparamlist = Ladybug_ShadingParametersList(
    westDepth=item.Item1,
    southDepth=item.Item,
    eastDepth=item.Item2,
    westNumOfShds="3",
    southNumOfShds="1",
    eastNumOfShds="3",
    westHorOrVert=toggle,
    eastHorOrVert=toggle,
    westShdAngle="30",
    eastShdAngle="30")  # -> readMe, depthList, numOfShdsList, horOrVertList, shdAngleList; plug-in component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
volume = Volume(Geometry=setepzonecnstr)  # -> Volume, Centroid
pdecon = Deconstruct(Point=volume.Centroid)  # -> XComponent, YComponent, ZComponent
cset = CreateSet(List=pdecon.ZComponent)  # -> Set, Map
lng = ListLength(List=cset.Set)
assign_paths = AssignPaths(InputData=flatten(setepzonecnstr), PathsToAssign=flatten(cset.Map))
panel_4 = Panel("""0
1""")
series = Series(Start=0, Step=1, Count=lng)
cull_i = CullIndex(List=series, Indices=panel_4, Wrap=True)
branch = TreeBranch(Tree=assign_paths, Path=cull_i, MaintainPaths=True)
branch_2 = TreeBranch(Tree=assign_paths, Path=panel_4, MaintainPaths=True)
openstudiohvacsystemslist = Honeybee_OpenStudioHVACSystemsList({"0. Ideal Air Loads": 0, "1. PTAC | Residential": 1, "2. PTHP | Residential": 2, "3. PSZ-AC": 3, "4. PSZ-HP": 4, "5. Packaged VAV w/ Reheat": 5, "6. Packaged VAV w/ PFP Boxes": 6, "7. VAV w/ Reheat": 7, "8. VAV w/ PFP Boxes": 8, "9. Warm Air Furnace - Gas Fired": 9, "10.Warm Air Furnace - Electric": 10}, selected="7. VAV w/ Reheat")
openstudiohvacsystemslist_2 = Honeybee_OpenStudioHVACSystemsList({"0. Ideal Air Loads": 0, "1. PTAC | Residential": 1, "2. PTHP | Residential": 2, "3. PSZ-AC": 3, "4. PSZ-HP": 4, "5. Packaged VAV w/ Reheat": 5, "6. Packaged VAV w/ PFP Boxes": 6, "7. VAV w/ Reheat": 7, "8. VAV w/ PFP Boxes": 8, "9. Warm Air Furnace - Gas Fired": 9, "10.Warm Air Furnace - Electric": 10}, selected="5. Packaged VAV w/ Reheat")
panel_5 = Panel("hourly")
decomposebytype = Honeybee_DecomposeBasedOnType(HBZone=flatten(glazingcreator.HBObjWGLZ))  # -> walls, windows, skylights, roofs, floors, ceilings, airWalls, shadings; plug-in component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
shddesigner = Ladybug_ShadingDesigner(
    glzSrf=flatten(decomposebytype.windows),
    depthOrVector=flatten(shdparamlist.depthList),
    numOfShds=shdparamlist.numOfShdsList,
    runIt=Toggle(True),
    port_4=False,
    horOrVertical=shdparamlist.horOrVertList,
    shdAngle=shdparamlist.shdAngleList)  # -> readMe, shadingSrfs; plug-in component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
writeresultparameters = Honeybee_WriteEPResultParameters(
    zoneEnergyUse=Toggle(True),
    zoneGainsAndLosses="False",
    zoneTemperatures=Toggle(True),
    surfaceAnalysis="False",
    timestep="monthly")  # -> report, simulationOutputs; plug-in component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
oshvacsystems = Honeybee_OpenStudioSystems(HBZones=flatten(branch), HVACSystems=openstudiohvacsystemslist)  # -> HBZones; plug-in component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
oshvacsystems_2 = Honeybee_OpenStudioSystems(HBZones=flatten(branch_2), HVACSystems=openstudiohvacsystemslist_2)  # -> HBZones; plug-in component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
hb_epcontextsrf = HoneybeeEPContextSurfaces(shdSurfaces=flatten(shddesigner.shadingSrfs), meshingLevel="0")  # -> readMe, HBContext; inputs shdSurfaces: list of GeometryBase, EPtransSchedule: list
# ---------- hb_epcontextsrf: Python ----------
"""
prepare shading/context geometries

    Args:
        northVectorOrRotation: A vector that shows North or a number that shows
                               the rotation of the North from the Y axis
        bldgMasses: List of closed Breps as thermal zones.
    Returns:
        report: ...
        thermalZones: Thermal zone's geometries for visualiza
"""

ghenv.Component.Name = 'Honeybee EP context Surfaces'
ghenv.Component.NickName = 'HB_EPContextSrf'
ghenv.Component.Message = 'VER 0.0.53\nMAY_12_2014'
ghenv.Component.Category = "Honeybee"
ghenv.Component.SubCategory = "09 | Energy | Energy"
ghenv.Component.AdditionalHelpFromDocStrings = "1"

import rhinoscriptsyntax as rs
import Rhino as rc
import scriptcontext as sc
import os
import System
from clr import AddReference
AddReference('Grasshopper')
import Grasshopper.Kernel as gh

tolerance = sc.doc.ModelAbsoluteTolerance
import math


def main():
    # import the classes
    if sc.sticky.has_key('ladybug_release')and sc.sticky.has_key('honeybee_release'):
        
        # don't customize this part
        hb_EPSrf = sc.sticky["honeybee_EPSurface"]
        hb_EPSHDSurface = sc.sticky["honeybee_EPShdSurface"]

        ########################################################################
        #----------------------------------------------------------------------#
        shdBreps = []
        if justBoundingBox:
            for brep in shdSurfaces:
                if brep.Faces.Count>1 or not brep.Faces[0].IsPlanar(sc.doc.ModelAbsoluteTolerance):
                    shdBreps.append(brep.GetBoundingBox(True).ToBrep())
                else:
                    shdBreps.append(brep)
        else: shdBreps = shdSurfaces
        
        shadingClasses = []
        shadingMeshPreview = []
        if meshingLevel == 0:
            mp = rc.Geometry.MeshingParameters.Minimal
            mp.SimplePlanes = True
        elif 0.25 < meshingLevel <0.75:
            mp = rc.Geometry.MeshingParameters.Default
        else:
            mp = rc.Geometry.MeshingParameters.Smooth
        
        def getRadMaterialName(radMaterial):
            nameStr = radMaterial.split(" ")[2]
            name =  nameStr.split("\n")[0]
            return name
        
        for brepCount, brep in enumerate(shdBreps):
            if len(brep.DuplicateEdgeCurves(False))>1:
                meshedGeo = rc.Geometry.Mesh.CreateFromBrep(brep, mp)
                for brepFaceIndex in range(brep.Faces.Count):
                    mesh = meshedGeo[brepFaceIndex]
                    #for meshCount, mesh in enumerate(meshedGeo):
                    thisShading = hb_EPSHDSurface(brep.Faces[brepFaceIndex].ToBrep(), 1000*brepCount + brepFaceIndex, 'shdSrf_' + `brepCount` + '_' + `brepFaceIndex`)
                    for faceIndex in  range(mesh.Faces.Count):
                        thisShading.collectMeshFaces(mesh.Faces.GetFaceVertices(faceIndex))
                    if EPConstruction!=None: thisShading.EPConstruction = EPConstruction
                    if RADConstruction!=None: thisShading.RadMaterial = getRadMaterialName(RADConstruction)
                    shadingClasses.append(thisShading)
                    # shadingMeshPreview.append(thisShading.meshedFace)
                    brepFaceIndex += 1
        
        # add to the hive
        hb_hive = sc.sticky["honeybee_Hive"]()
        HBContext  = hb_hive.addToHoneybeeHive(shadingClasses, ghenv.Component.InstanceGuid.ToString())
        return HBContext
        ################################################################################################
    else:
        print "You should first let both Ladybug and Honeybee to fly..."
        w = gh.GH_RuntimeMessageLevel.Warning
        ghenv.Component.AddRuntimeMessage(w, "You should first let both Ladybug and Honeybee to fly...")
        return -1
        

if shdSurfaces and shdSurfaces[0]!=None:
    # add cleaning function
    result= main()
    
    if result != -1: HBContext = result
# ---------- end hb_epcontextsrf ----------
localdir = Text(c_script.A)
preview_3 = CustomPreview(Geometry=shddesigner.shadingSrfs, Shader=ColourSwatch(SwatchColor=RGBA(204, 204, 204, 226)))
preview_4 = CustomPreview(Geometry=decomposebytype.walls, Shader=ColourSwatch(SwatchColor=RGBA(255, 255, 120, 226)))
preview_5 = CustomPreview(Geometry=decomposebytype.windows, Shader=ColourSwatch(SwatchColor=RGBA(120, 226, 255, 116)))
preview_6 = CustomPreview(Geometry=decomposebytype.roofs, Shader=ColourSwatch(SwatchColor=RGBA(89, 89, 89, 226)))
preview_7 = CustomPreview(Geometry=decomposebytype.floors, Shader=ColourSwatch(SwatchColor=RGBA(230, 129, 129, 226)))
exporttoopenstudio = Honeybee_ExportToOpenStudio(
    epwWeatherFile=open_epw_stat.epwFile,
    HBZones=flatten([oshvacsystems_2, oshvacsystems]),
    HBContext=flatten(hb_epcontextsrf.HBContext),
    simulationOutputs=writeresultparameters.simulationOutputs,
    writeOSM=Toggle(True),
    runSimulation=Toggle(True),
    fileName="simRun",
    workingDir=localdir)  # -> ReadMe, osmFileAddress, idfFileAddress, resultsFileAddress; plug-in component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
readidf = Honeybee_ReadEPResult(resultFileAddress=exporttoopenstudio.idfFileAddress)  # -> report, port, simplify(zoneHeating), simplify(zoneCooling), zoneElectricLight, zoneElectricEquip, port_2, zonePeopleGains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; plug-in component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
data = Data(flatten(readidf.zoneAirTemperature))
data_2 = Data(flatten(readidf.zoneMeanRadiantTemperature))
pmvcomfortcalculator = Ladybug_PMVComfortCalculator(
    dryBulbTemperature=readidf.zoneAirTemperature,
    meanRadiantTemperature=readidf.zoneMeanRadiantTemperature,
    relativeHumidity=separatedata.numbers,
    eightyPercentComfortable=True,
    calcBalanceTemperature=False,
    runIt=Toggle(True))  # -> readMe, port, predictedMeanVote, percentPeopleDissatisfied, standardEffectiveTemperature, port_2, comfortableOrNot, percentOfTimeComfortable, port_3, balanceTemperature; plug-in component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
area_3 = Area(Geometry=decomposebytype.floors)  # -> Area, Centroid
data_3 = Data(flatten(pmvcomfortcalculator.percentOfTimeComfortable))
subtraction_2 = Subtraction(A=100, B=data_3)

brep_2 = Brep(mass2zone.HBZones)
sort = SortList(Keys=subtraction_2)  # -> Keys, ValuesA
rev = ReverseList(List=sort.Keys)
pt_3 = ConstructPoint(XCoordinate=200, YCoordinate=200, ZCoordinate=0)
item_3 = ListItem(List=rev, Index=0, Wrap=True)
item_4 = ListItem(List=sort.Keys, Index=0, Wrap=True)
move_2 = Move(Geometry=brep_2, Motion=pt_3)  # -> Geometry, Transform
gradient = Gradient(
    LowerLimit=item_4,
    UpperLimit=item_3,
    Parameter=subtraction_2,
    stops=[0: RGB(0, 128, 0), 0.5: RGB(255, 255, 0), 1: RGB(255, 0, 0)])
preview_8 = CustomPreview(Geometry=move_2.Geometry, Shader=gradient)

avr = Average(Input=data_3)
ma = MassAddition(Input=flatten(readidf.zoneHeating))  # -> Result, PartialResults
ma_2 = MassAddition(Input=flatten(readidf.zoneCooling))  # -> Result, PartialResults
addition_2 = Addition(A=ma.Result, B=ma_2.Result)
subtraction_3 = Subtraction(A=100, B=avr)
multiplication_3 = Multiplication(A=subtraction_3, B=10000)
addition_3 = Addition(A=addition_2, B=multiplication_3)
total_heating = Panel(ma.Result)
total_cooling = Panel(ma_2.Result)
percent_of_time_uncomfortable = Panel(subtraction_3)
fittness = Panel(addition_3)
total_thermal_energy = Panel(addition_2)
bbox = BoundingBox(Content=move_2.Geometry, Plane=PlaneXY(0, 0, 0), UnionBox=True)  # -> Box, Box_2
number_slider_2 = Slider(259, range=0..1000)
box = EvaluateBox(Box=bbox.Box, UParameter=0.5, VParameter=0.5, WParameter=0.5)  # -> Plane, Point, Include
pt_4 = ConstructPoint(XCoordinate=Slider(359, range=0..1000), YCoordinate=Slider(231, range=0..1000), ZCoordinate=0)
neg_2 = Negative(Value=box.Point)
pt_5 = ConstructPoint(XCoordinate=number_slider_2, YCoordinate=Slider(461, range=0..1000), ZCoordinate=0)
move_3 = Move(Geometry=move_2.Geometry, Motion=neg_2)  # -> graft(Geometry), Transform
number_slider_3 = Slider(9, range=0..10)
mcol = MeshColours(Mesh=move_3.Geometry, Colours=graft(gradient))
number_slider_4 = Slider(39, range=0..100)
pt_6 = ConstructPoint(XCoordinate=number_slider_2, YCoordinate=Slider(63, range=0..1000), ZCoordinate=0)
pan = Panel("""Uncomfortable
Hours""")
number_slider_5 = Slider(13, range=0..100)
mjoin = MeshJoin(Meshes=flatten(mcol))
pt_7 = ConstructPoint(XCoordinate=Slider(359, range=0..1000), YCoordinate=Slider(721, range=0..1000), ZCoordinate=0)
pan_2 = Panel("""Total Heating
Total Cooling
Total Thermal Energy
Percent Time Uncomfortable
Fitness
capture""")
number_slider_6 = Slider(9, range=0..10)
texttoscreen = RenderTextToScreen(Text=pan, Location=pt_5, Size=number_slider_4, Color=RGB(0, 0, 0), m_scWithvp=True)
texttoscreen_2 = RenderTextToScreen(Text="Heating/Cooling", Location=pt_6, Size=number_slider_4, Color=RGB(0, 0, 0), m_scWithvp=True)
meshtoscreen = RenderMeshToScreen(Mesh=mjoin, Location=pt_7, ScaleFactor=number_slider_5, Depth=0.95, Fixed=False, m_scWithvp=True)
pan_3 = Panel("C:/Data/")
data_4 = Data(readjson.b)
data_5 = Data(readjson.a)
merge = Merge(Data1=flatten(data_5), Data2=flatten(pan_2))

ma_3 = MassAddition(Input=[readidf.zoneHeating, readidf.zoneCooling])  # -> flatten(Result), PartialResults
brep_3 = Brep(mass2zone.HBZones)
pt_8 = ConstructPoint(XCoordinate=200, YCoordinate=0, ZCoordinate=0)
move_4 = Move(Geometry=brep_3, Motion=pt_8)  # -> Geometry, Transform

division_2 = Division(A=ma_3.Result, B=flatten(area_3.Area))
bbox_2 = BoundingBox(Content=flatten(brep_3), Plane=PlaneXY(0, 0, 0), UnionBox=True)  # -> Box, Box_2

sort_2 = SortList(Keys=division_2)  # -> Keys, ValuesA
rev_2 = ReverseList(List=sort_2.Keys)
item_5 = ListItem(List=rev_2, Index=0, Wrap=True)
item_6 = ListItem(List=sort_2.Keys, Index=0, Wrap=True)
gradient_2 = Gradient(
    LowerLimit=item_6,
    UpperLimit=item_5,
    Parameter=division_2,
    stops=[0: RGB(234, 38, 0), 0.25: RGB(234, 126, 0), 0.5: RGB(254, 244, 84), 0.75: RGB(173, 203, 249), 1: RGB(75, 107, 169)])
preview_9 = CustomPreview(Geometry=move_4.Geometry, Shader=gradient_2)

extend_box = ExtendBox(box=bbox_2.Box, X=Slider(3, range=0..10), Y=0, Z=0)
bbox_3 = BoundingBox(Content=move_4.Geometry, Plane=PlaneXY(0, 0, 0), UnionBox=True)  # -> Box, Box_2
box_2 = EvaluateBox(Box=bbox_3.Box, UParameter=0.5, VParameter=0.5, WParameter=0.5)  # -> Plane, Point, Include
neg_3 = Negative(Value=box_2.Point)
move_5 = Move(Geometry=move_4.Geometry, Motion=neg_3)  # -> graft(Geometry), Transform
mcol_2 = MeshColours(Mesh=move_5.Geometry, Colours=graft(gradient_2))
zbb = ZoomBoundingBox(box=extend_box, x="Perspective", run=Toggle(True))  # -> out, A; inputs box: Box, x: String, run: Boolean; disabled
# ---------- zbb: C# ----------
    if(run){
      string script = "-Grid Applyto=allviewports showgridaxes=no showgrid=no showworldaxes=no";
      Rhino.RhinoApp.RunScript(script, false);
      doc.Views.Find(x, false).ActiveViewport.ZoomBoundingBox(box.BoundingBox);
    }
# ---------- end zbb ----------
mjoin_2 = MeshJoin(Meshes=flatten(mcol_2))
c_script_2 = CSharpScript(x="Perspective", y=zbb.A)  # -> out, A; inputs x: String; disabled
# ---------- c_script_2: C# ----------
    List<object> os = new List<object>();
    Rhino.Display.RhinoView view = RhinoDocument.Views.Find(x, false);
    
    Bitmap bmp = view.CaptureToBitmap(view.MainViewport.Size);
    A = Convert.ToBase64String(ImageToByte(bmp));
# ---------- c_script_2: C# additional code ----------
  public static byte[] ImageToByte(Image img)
  {
    ImageConverter converter = new ImageConverter();
    return (byte[]) converter.ConvertTo(img, typeof(byte[]));
  }
# ---------- end c_script_2 ----------
meshtoscreen_2 = RenderMeshToScreen(Mesh=mjoin_2, Location=pt_4, ScaleFactor=number_slider_5, Depth=0.95, Fixed=False, m_scWithvp=True)
merge_2 = Merge(
    Data1=flatten(total_heating),
    Data2=flatten(total_cooling),
    Data3=flatten(total_thermal_energy),
    Data4=flatten(percent_of_time_uncomfortable),
    Data5=flatten(fittness),
    Data6=flatten(c_script_2.A))
merge_3 = Merge(Data1=flatten(data_4), Data2=flatten(merge_2))
mkdict = PythonScript(x=merge, y=merge_3)  # -> out, a, b; inputs x: list, y: list
# ---------- mkdict: Python ----------
import json
dict = {}
for i,j in zip(x,y):
    dict[i] = j
arrDict = [dict]
a = arrDict
b = json.dumps(dict)
# ---------- end mkdict ----------
writeresults_2 = WriteResults(x=zbb.A, data=mkdict.b, y=format_3)

# ==== cluster WriteResults
y = ClusterInput()
x = ClusterInput()
data = ClusterInput()
writetexttofile = CSharpScript(x=x, data=data, y=y)  # -> out, A; inputs x: tree, data: list of String, y: String
# ---------- writetexttofile: C# ----------
    string folderPath = Path.GetDirectoryName(y);
    if(!System.IO.Directory.Exists(folderPath)){
      System.IO.Directory.CreateDirectory(folderPath);
    }
    using (System.IO.StreamWriter file = new System.IO.StreamWriter(y))
    {
      foreach (string line in data)
      {

        file.WriteLine(line);

      }
    }
# ---------- end writetexttofile ----------
A = ClusterOutput(writetexttofile.A)

# ==== cluster ExtendBox: Extends (or shrinks) the dimension of a box by a specified amount about the box plane.
X = ClusterInput()
Y = ClusterInput()
Z = ClusterInput()
box = ClusterInput()
pt = PointXYZ(XComponent=X, YComponent=Y, ZComponent=Z, System=PlaneXY(0, 0, 0))
box_2 = Box(box)
box_3 = EvaluateBox(Box=box_2, UParameter=0.5, VParameter=0.5, WParameter=0.5)  # -> Plane, Point, Include
box_4 = BoxComponents(Box=box_2)  # -> Plane, X, Y, Z
pt_2 = PointXYZ(XComponent=box_4.X, YComponent=box_4.Y, ZComponent=box_4.Z, System=PlaneXY(0, 0, 0))
addition = Addition(A=pt_2, B=pt)
c_script = CSharpScript(x=addition, y=pt_2)  # -> out, A; "pt/pt"; inputs x: Point3d, y: Point3d
# ---------- c_script: C# ----------
    A = new Point3d(x.X / y.X, x.Y / y.Y, x.Z / y.Z);
# ---------- end c_script ----------
pcomp = Decompose(Point=c_script.A, System=PlaneXY(0, 0, 0))  # -> XComponent, YComponent, ZComponent
scale_nu = ScaleNU(Geometry=box_2, Plane=box_3.Plane, ScaleX=pcomp.XComponent, ScaleY=pcomp.YComponent, ScaleZ=pcomp.ZComponent)  # -> Geometry, Transform
box_5 = Box(scale_nu.Geometry)
box_6 = ClusterOutput(box_5)
