# Grasshopper definition MacroLauncher.gh (Grasshopper 0.9.75)

pan = Panel("_Escape _Escape -Grasshopper Document Open \"{0}\" Document Close Enter")
file = ReadFile(File="C:\Users\Andheum\Desktop\Macro\GHFileList.txt", PerLineParse=True)
format = Format(Format=pan, Culture=127, Data0=file)
item = ListItem(List=format, Index=0, Wrap=True)
c_script = CSharpScript(macro=format)  # -> out, A; inputs macro: String
# ---------- c_script: C# ----------
    RhinoApp.RunScript(macro, false);
# ---------- end c_script ----------
panel = Panel(item)
