# Grasshopper definition MakeJsonParameterSet.gh (Grasshopper 0.9.75)
# plug-ins: SustainForGH, HDTReference, Google Drive for GH 

minimum_airflow_at_terminal_box = Slider(1, range=0..1)
lighting_power_density = Slider(1, range=0..1)
plug_load_power_density = Slider(1, range=0..1)
panel = Panel("C:\Users\Andheum\Desktop\Macro\SliderTest.gh")
pan = Panel("ModSlider01")
button = Button()
dir = DirectoryContents(Filter="*", IncludeSubfolders=False)  # -> FilePaths, FileNames
bslider = BatchSlider(BatchVariable=plug_load_power_density, Steps=5)
bslider_2 = BatchSlider(BatchVariable=minimum_airflow_at_terminal_box, Steps=5)
bslider_3 = BatchSlider(BatchVariable=lighting_power_density, Steps=5)
getconnectedsliders = CSharpScript(x=[plug_load_power_density, lighting_power_density, minimum_airflow_at_terminal_box])  # -> out, A, B; inputs x: tree
# ---------- getconnectedsliders: C# ----------
    List<string> sliderList = new List<string>();
    foreach(GH_DocumentObject obj in GrasshopperDocument.Objects) {
      if(obj is GH_ActiveObject){
        GH_ActiveObject act = obj as GH_ActiveObject;
        Grasshopper.Kernel.Special.GH_NumberSlider slider = obj as Grasshopper.Kernel.Special.GH_NumberSlider;
        if (slider != null){
          if(this.Component.DependsOn(act)){
            sliderList.Add(slider.NickName);
          }
        }
      }
    }
    A = sliderList;
    B = x;
# ---------- end getconnectedsliders ----------
gauth = GoogleAuthenticator(Authenticate=invert(False), ClearCredentials=False)
batchdriver = BatchDriver(
    Run=Toggle(True),
    FilePath="C:\Users\Andheum\Desktop\testout",
    Name="Pollinator",
    ValuesA=bslider,
    ValuesB=bslider_3,
    ValuesC=bslider_2)  # -> Path, ValuesA, ValuesB, ValuesC
spreadsheetlist = SpreadsheetList(Token=gauth, Refresh=True)
merge = Merge(Data1=batchdriver.ValuesA, Data2=batchdriver.ValuesB, Data3=batchdriver.ValuesC)
format = Format(Format="{0}.gh", Culture=127, Data0=batchdriver.Path)
list = ItemSelector(
    spreadsheetlist,
    {"money", "Papples", "GH_Leafcutter Test 2", "Example Spreadsheet Name", "Pickle Wist", "Pub", "Untitled spreadsheet", "this is an old sheet 2", "Piffles", "this is an old sheet"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}, selected="TT Symposium Budget")
setslidervalue = CSharpScript(
    ghPath="C:\Users\Andheum\Desktop\Macro\DefMaster.gh",
    outPath=format,
    run=Toggle(True),
    slName=getconnectedsliders.A,
    slVals=merge)  # -> out, A, B; inputs ghPath: String, outPath: String, run: Boolean, slName: list of String, slVals: list of Double
# ---------- setslidervalue: C# ----------
    Dictionary<string,double> setDict = new Dictionary<string,double>();
    for(int i = 0;i < slName.Count;i++){
      setDict.Add(slName[i], slVals[i]);
    }

    if(run){
      GH_Archive archive = new GH_Archive();
      archive.ReadFromFile(ghPath);
      GH_Chunk rootNode = archive.GetRootNode;

      GH_Chunk defChunk = rootNode.FindChunk("Definition") as GH_Chunk;
      GH_Chunk defObjChunk = defChunk.FindChunk("DefinitionObjects") as GH_Chunk;

      foreach(GH_Chunk objchunk in defObjChunk.Chunks){
        GH_Chunk containerChunk = objchunk.FindChunk("Container") as GH_Chunk;

        GH_IO.Types.GH_Item nameItem = containerChunk.FindItem("NickName");
        string sliderName = nameItem._string;
        if(setDict.ContainsKey(sliderName)){
          Print("found it");
          GH_Chunk sliderChunk = containerChunk.FindChunk("Slider") as GH_Chunk;
          GH_IO.Types.GH_Item valItem = sliderChunk.FindItem("Value");
          Print(valItem._double.ToString());

          int index = valItem.Index;
          sliderChunk.RemoveItem("Value");
          sliderChunk.SetDouble("Value", index, setDict[sliderName]);

        }
      }


      A = archive.Serialize_Xml();

      archive.WriteToFile(outPath, true, true);

    }
# ---------- setslidervalue: C# additional code ----------
  public string objNickName(GH_Chunk chunk){
    GH_Chunk container = chunk.FindChunk("Container") as GH_Chunk;
    GH_IO.Types.GH_Item nicknameItem = container.FindItem("NickName");
    return nicknameItem._string;
  }

  public string objPanelContents(GH_Chunk chunk){
    GH_Chunk container = chunk.FindChunk("Container") as GH_Chunk;
    GH_IO.Types.GH_Item nicknameItem = container.FindItem("UserText");
    return nicknameItem._string;
  }

  public byte[] FileToByteArray(string fileName)
  {
    byte[] buff = null;
    FileStream fs = new FileStream(fileName,
      FileMode.Open,
      FileAccess.Read);
    BinaryReader br = new BinaryReader(fs);
    long numBytes = new FileInfo(fileName).Length;
    buff = br.ReadBytes((int) numBytes);
    return buff;
  }
# ---------- end setslidervalue ----------
readspreadsheet = ReadFromSpreadsheet(Token=gauth, Name=list, IncludeBlankCells=False, OrganizeByRowsOrColumns=False, ReadFormulasOrValues=False, Refresh=True)  # -> Values, CellAddresses, SheetInfo
writespreadsheet = WriteToSpreadsheet(OrganizeByRowsOrColumns=False, Write=False, createNewSpreadsheets=False)
panel_2 = Panel(readspreadsheet.CellAddresses)
