# Grasshopper definition ReadImgFromJson.gh (Grasshopper 0.9.75)
# plug-ins: Python Interpreter, HDTReference

number_slider = Slider(777, range=0..1000)
panel = Panel("C:\Data\DefMaster_results.json")
dir = DirectoryContents(FolderPath="C:\Users\Andheum\Swarm", Filter="*done.receipt", IncludeSubfolders=True)  # -> FilePaths, FileNames
list = ItemSelector(
    dir.FilePaths,
    {"C:\Users\Andheum\Swarm\job_11352c00-c068-0131-4cb2-020f38d10afd\done.receipt", "C:\Users\Andheum\Swarm\job_1307ba81-c068-0131-4cb3-020f38d10afd\done.receipt", "C:\Users\Andheum\Swarm\job_144451c0-c068-0131-4cb5-020f38d10afd\done.receipt", "C:\Users\Andheum\Swarm\job_1616e050-c068-0131-4cb7-020f38d10afd\done.receipt", "C:\Users\Andheum\Swarm\job_16bd80b0-c068-0131-4cb9-020f38d10afd\done.receipt", "C:\Users\Andheum\Swarm\job_188dada0-c068-0131-4cbb-020f38d10afd\done.receipt"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}, selected="C:\Users\Andheum\Swarm\job_2eac9f61-c068-0131-4d06-020f38d10afd\done.receipt")
srf = Srf(<srf referenced from the Rhino model>)
item = ListItem(List=dir.FilePaths, Index=number_slider, Wrap=True)
file = ReadFile(File=item, PerLineParse=True)
readjson = PythonScript(x=file)  # -> out, a, b
# ---------- readjson: Python ----------
import json
dict = json.loads(x)
keys = []
vals = []
for key in dict:
     keys.append(key)
     vals.append(dict[key])
a = keys
b = vals
# ---------- end readjson ----------
item_2 = ListItem(List=dir.FileNames, Index=number_slider, Wrap=True)
fsim = FindSimilarMember(Data="capture", Set=readjson.a)  # -> Hit, Index
format = Format(Format="{0}.receipt", Culture=127, Data0=item_2)
rep = ReplaceText(Text=item, Find=format, Replace="ParamSet.json", RecursiveReplace=False)
item_3 = ListItem(List=readjson.b, Index=fsim.Index, Wrap=True)
file_2 = ReadFile(File=rep, PerLineParse=True)
c_script = CSharpScript(x=item_3)  # -> out, A; inputs x: String
# ---------- c_script: C# ----------
    byte[] array = Convert.FromBase64String(x);
    System.ComponentModel.TypeConverter tc = System.ComponentModel.TypeDescriptor.GetConverter(typeof(Bitmap));
    Bitmap bitmap1 = (Bitmap) tc.ConvertFrom(array);
    string saveDir = @"C:\data\imgTest.jpg";
    bitmap1.Save(saveDir);
    A = saveDir;
# ---------- end c_script ----------
readjson_2 = PythonScript(x=file_2)  # -> out, a, b; same code as readjson
previewmat = CustomPreviewMaterials(Geometry=srf, DiffuseColor=RGB(255, 255, 255), DiffuseBitmap=c_script.A)
previewmat_2 = CustomPreviewMaterials(DiffuseColor=RGB(255, 255, 255))
