# Grasshopper definition SetSlider.gh (Grasshopper 0.9.75)

panel = Panel("C:\Users\Andheum\Desktop\Macro\SliderTest.gh")
button = Button()
toggle = BooleanToggle(True)
c_script = CSharpScript(GhPath=panel, SlName="ModSlider01")  # -> Out, A
setslidervalue = CSharpScript(ghPath=panel, run=Toggle(True), slName="ModSlider01")  # -> out, A, B; inputs ghPath: String, run: Boolean, slName: String
# ---------- setslidervalue: C# ----------
    if(run){
      GH_Archive archive = new GH_Archive();
      archive.ReadFromFile(ghPath);
      GH_Chunk rootNode = archive.GetRootNode;

      GH_Chunk defChunk = rootNode.FindChunk("Definition") as GH_Chunk;
      GH_Chunk defObjChunk = defChunk.FindChunk("DefinitionObjects") as GH_Chunk;

      foreach(GH_Chunk objchunk in defObjChunk.Chunks){
        GH_Chunk containerChunk = objchunk.FindChunk("Container") as GH_Chunk;

        GH_IO.Types.GH_Item nameItem = containerChunk.FindItem("NickName");
        if(nameItem._string == slName){
          Print("found it");
          GH_Chunk sliderChunk = containerChunk.FindChunk("Slider") as GH_Chunk;
          GH_IO.Types.GH_Item valItem = sliderChunk.FindItem("Value");
          Print(valItem._double.ToString());

          int index = valItem.Index;
          sliderChunk.RemoveItem("Value");
          sliderChunk.SetDouble("Value", index, 1.0);

        }
      }


      A = archive.Serialize_Xml();

      archive.WriteToFile(ghPath, true, true);

    }
# ---------- setslidervalue: C# additional code ----------
  public string objNickName(GH_Chunk chunk){
    GH_Chunk container = chunk.FindChunk("Container") as GH_Chunk;
    GH_IO.Types.GH_Item nicknameItem = container.FindItem("NickName");
    return nicknameItem._string;
  }

  public string objPanelContents(GH_Chunk chunk){
    GH_Chunk container = chunk.FindChunk("Container") as GH_Chunk;
    GH_IO.Types.GH_Item nicknameItem = container.FindItem("UserText");
    return nicknameItem._string;
  }

  public byte[] FileToByteArray(string fileName)
  {
    byte[] buff = null;
    FileStream fs = new FileStream(fileName,
      FileMode.Open,
      FileAccess.Read);
    BinaryReader br = new BinaryReader(fs);
    long numBytes = new FileInfo(fileName).Length;
    buff = br.ReadBytes((int) numBytes);
    return buff;
  }
# ---------- end setslidervalue ----------
