# Grasshopper definition StraightSkeleton.gh (Grasshopper 0.9.75)

crv = Curve(<curve referenced from the Rhino model>)
divide = DivideCurve(Curve=crv, Count=Slider(580, range=0..1000), Kinks=False)  # -> Points, Tangents, Parameters
voronoi = Voronoi(Points=divide.Points, BruteForceOverride=False)
explode = Explode(Curve=voronoi, Recursive=True)  # -> flatten(Segments), Vertices
ccx = CurveCurve(CurveA=graft(explode.Segments), CurveB=crv)  # -> Points, ParamsA, ParamsB
lng = ListLength(List=reverse(simplify(ccx.Points)))  # -> simplify(Length)
dispatch = Dispatch(List=graft(explode.Segments), DispatchPattern=lng)  # -> ListA, ListB
crv_2 = Curve(dispatch.ListB)
