# Grasshopper definition Parameterized File.gh (Grasshopper 0.9.75)
# plug-ins: Python Interpreter, HDTReference

eastshadingdepth = Slider(0.5, range=0..1)
southshadingdepth = Slider(1, range=0..2)
westshadingdepth = Slider(0.5, range=0..1)
# Parameters
height = Slider(20, range=20..30)
taper = Slider(0.2, range=-0.6..0.4)
brep = Brep([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])
ladybug = Ladybug_Ladybug()  # -> Vviiiiiiiiiizzz; plug-in component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
honeybee = Honeybee_Honeybee()  # -> Vviiiiiiiiiizzz; plug-in component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
crv = Curve([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])
preview = CustomPreview(Geometry=brep, Shader=ColourSwatch(SwatchColor=RGBA(186, 186, 186, 159)))
preview_2 = CustomPreview(Geometry=crv, Shader=ColourSwatch(SwatchColor=RGB(0, 0, 0)))
panel = Panel("http://apps1.eere.energy.gov/buildings/energyplus/weatherdata/4_north_and_central_america_wmo_region_4/1_usa/USA_NY_New.York-J.F.Kennedy.Intl.AP.744860_TMY3.zip")
pt = Point(Point(11.44104369, 2.352967986, 0))
vec = Vector(Vector(-8.845523185, 4.599579565, 0))
pow = Power(A="5", B=2)
multiplication = Multiplication(A=pow, B=height)
pl = ConstructPlane(Origin=pt, XAxis=vec, YAxis=Vector(0, 1, 0))
division = Division(A=1000, B=multiplication)
open_epw_stat = Ladybug_OpenEPWAndSTATWeatherFiles(weatherFileURL=panel)  # -> epwFile, statFile; plug-in component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
multiplication_2 = Multiplication(A="5", B=division)
neg = Negative(Value=multiplication_2)
rectangle = Rectangle(Plane=pl, XSize=multiplication_2, YSize=neg, Radius=0)  # -> Rectangle, Length
pt_2 = ConstructPoint(XCoordinate=0, YCoordinate=0, ZCoordinate=height)
area = Area(Geometry=rectangle.Rectangle)  # -> Area, Centroid
move = Move(Geometry=rectangle.Rectangle, Motion=pt_2)  # -> Geometry, Transform
addition = Addition(A=taper, B=1)
area_2 = Area(Geometry=move.Geometry)  # -> Area, Centroid
subtraction = Subtraction(A=1, B=taper)
scale = Scale(Geometry=move.Geometry, Center=area_2.Centroid, Factor=subtraction)  # -> Geometry, Transform
scale_2 = Scale(Geometry=rectangle.Rectangle, Center=area.Centroid, Factor=addition)  # -> Geometry, Transform
importepw = Ladybug_ImportEpw(epwFile=open_epw_stat.epwFile)  # -> readMe, latitude, location, dryBulbTemperature, dewPointTemperature, relativeHumidity, windSpeed, windDirection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; plug-in component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
importstat = Ladybug_ImportStat(statFile=open_epw_stat.statFile)  # -> readMe, ashraeClimateZone, koppenClimateZone, port, heatingDesignTemp, coolingDesignTemp, port_2, extremeHotWeek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; plug-in component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
loft = Loft(
    Curves=[scale_2.Geometry, scale.Geometry],
    Options={Adjust=False, Closed=False, LoftEnds=0, LoftSimp=0, LoftType=0, Rebuild=10, Refit=0.01})
cap = CapHoles(Brep=loft)
selectandaveragedata = Ladybug_AverageData(annualHourlyData=importepw.relativeHumidity)  # -> readMe, selHourlyData, averagedDaily, averagedMonthly, avrMonthlyPerHour; plug-in component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
splitmass = Honeybee_SplitBuildingMass(bldgMasses=cap, bldgsFlr2FloorHeights="@4", perimeterZoneDepth="@2", runIt=Toggle(True))  # -> out, splitBldgMasses; plug-in component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
separatedata = Ladybug_SeparateData(inputList=selectandaveragedata.averagedMonthly)  # -> numbers, strings; plug-in component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
mass2zone = Honeybee_Masses2Zones(bldgMasses=flatten(splitmass.splitBldgMasses), maximumRoofAngle=30, createHoneybeeZones=Toggle(True))  # -> readMe, HBZones; plug-in component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
glzparamlist = Honeybee_GlazingParametersList(northGlzRatio="0.4", westGlzRatio="0.4", southGlzRatio=Slider(0.7, range=0..1), eastGlzRatio="0.4")  # -> readMe, glzRatioList, windowHeightList, sillHeightList; plug-in component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
callfromepconstrlibrary = Honeybee_CallFromEPConstructionLibrary()  # -> EPMaterials, EPWindowMaterils, EPConstructios; plug-in component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
solveadjc = Honeybee_SolveAdjacencies(HBZones=flatten(mass2zone.HBZones), findAdjc=Toggle(True))  # -> readMe, HBZonesWADJ; plug-in component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
panel_2 = Panel("""WALL
ROOF
FLOOR
CEILING
WINDOW""")
graft = GraftTree(Tree=panel_2, IncludeEmptyLists=True, IncludeNullItems=True)
searchepconstruction = Honeybee_SearchEPConstruction(
    EPConstrList=callfromepconstrlibrary.EPConstructios,
    standard=Slider(0, range=0..100),
    climateZone=importstat.ashraeClimateZone,
    surfaceType=graft)  # -> EPSelectedConstr; plug-in component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
glazingcreator = Honeybee_GlazingBasedOnRatio(
    HBObjects=flatten(solveadjc.HBZonesWADJ),
    glzRatio=flatten(glzparamlist.glzRatioList),
    breakUpWindow=Toggle(False),
    runIt=Toggle(True))  # -> readMe, HBObjWGLZ; plug-in component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
item = ListItem(List=searchepconstruction, Index=0, Wrap=True)
bang = ExplodeTree(Data=simplify(item))  # -> Branch0, Branch1, Branch2, Branch3, Branch4
setepzonecnstr = Honeybee_SetEPZoneConstruction(
    HBZone=glazingcreator.HBObjWGLZ,
    wallEPConstruction=bang.Branch0,
    windowEPConstruction=bang.Branch4,
    roofEPConstruction=bang.Branch1,
    floorEPConstruction=bang.Branch2)  # -> simplify(modifiedHBZone); plug-in component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
toggle = BooleanToggle(False)
shdparamlist = Ladybug_ShadingParametersList(
    westDepth=westshadingdepth,
    southDepth=southshadingdepth,
    eastDepth=eastshadingdepth,
    westNumOfShds="3",
    southNumOfShds="1",
    eastNumOfShds="3",
    westHorOrVert=toggle,
    eastHorOrVert=toggle,
    westShdAngle="30",
    eastShdAngle="30")  # -> readMe, depthList, numOfShdsList, horOrVertList, shdAngleList; plug-in component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
decomposebytype = Honeybee_DecomposeBasedOnType(HBZone=flatten(glazingcreator.HBObjWGLZ))  # -> walls, windows, skylights, roofs, floors, ceilings, airWalls, shadings; plug-in component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
shddesigner = Ladybug_ShadingDesigner(
    glzSrf=flatten(decomposebytype.windows),
    depthOrVector=flatten(shdparamlist.depthList),
    numOfShds=shdparamlist.numOfShdsList,
    runIt=Toggle(True),
    port_4=False,
    horOrVertical=shdparamlist.horOrVertList,
    shdAngle=shdparamlist.shdAngleList)  # -> readMe, shadingSrfs; plug-in component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
panel_3 = Panel("hourly")
writeresultparameters = Honeybee_WriteEPResultParameters(
    zoneEnergyUse=Toggle(True),
    zoneGainsAndLosses="False",
    zoneTemperatures=Toggle(True),
    surfaceAnalysis="False",
    timestep="monthly")  # -> report, simulationOutputs; plug-in component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
hb_epcontextsrf = HoneybeeEPContextSurfaces(shdSurfaces=flatten(shddesigner.shadingSrfs), meshingLevel="0")  # -> readMe, HBContext; inputs shdSurfaces: list of GeometryBase, EPtransSchedule: list
# ---------- hb_epcontextsrf: Python ----------
"""
prepare shading/context geometries

    Args:
        northVectorOrRotation: A vector that shows North or a number that shows
                               the rotation of the North from the Y axis
        bldgMasses: List of closed Breps as thermal zones.
    Returns:
        report: ...
        thermalZones: Thermal zone's geometries for visualiza
"""

ghenv.Component.Name = 'Honeybee EP context Surfaces'
ghenv.Component.NickName = 'HB_EPContextSrf'
ghenv.Component.Message = 'VER 0.0.53\nMAY_12_2014'
ghenv.Component.Category = "Honeybee"
ghenv.Component.SubCategory = "09 | Energy | Energy"
ghenv.Component.AdditionalHelpFromDocStrings = "1"

import rhinoscriptsyntax as rs
import Rhino as rc
import scriptcontext as sc
import os
import System
from clr import AddReference
AddReference('Grasshopper')
import Grasshopper.Kernel as gh

tolerance = sc.doc.ModelAbsoluteTolerance
import math


def main():
    # import the classes
    if sc.sticky.has_key('ladybug_release')and sc.sticky.has_key('honeybee_release'):
        
        # don't customize this part
        hb_EPSrf = sc.sticky["honeybee_EPSurface"]
        hb_EPSHDSurface = sc.sticky["honeybee_EPShdSurface"]

        ########################################################################
        #----------------------------------------------------------------------#
        shdBreps = []
        if justBoundingBox:
            for brep in shdSurfaces:
                if brep.Faces.Count>1 or not brep.Faces[0].IsPlanar(sc.doc.ModelAbsoluteTolerance):
                    shdBreps.append(brep.GetBoundingBox(True).ToBrep())
                else:
                    shdBreps.append(brep)
        else: shdBreps = shdSurfaces
        
        shadingClasses = []
        shadingMeshPreview = []
        if meshingLevel == 0:
            mp = rc.Geometry.MeshingParameters.Minimal
            mp.SimplePlanes = True
        elif 0.25 < meshingLevel <0.75:
            mp = rc.Geometry.MeshingParameters.Default
        else:
            mp = rc.Geometry.MeshingParameters.Smooth
        
        def getRadMaterialName(radMaterial):
            nameStr = radMaterial.split(" ")[2]
            name =  nameStr.split("\n")[0]
            return name
        
        for brepCount, brep in enumerate(shdBreps):
            if len(brep.DuplicateEdgeCurves(False))>1:
                meshedGeo = rc.Geometry.Mesh.CreateFromBrep(brep, mp)
                for brepFaceIndex in range(brep.Faces.Count):
                    mesh = meshedGeo[brepFaceIndex]
                    #for meshCount, mesh in enumerate(meshedGeo):
                    thisShading = hb_EPSHDSurface(brep.Faces[brepFaceIndex].ToBrep(), 1000*brepCount + brepFaceIndex, 'shdSrf_' + `brepCount` + '_' + `brepFaceIndex`)
                    for faceIndex in  range(mesh.Faces.Count):
                        thisShading.collectMeshFaces(mesh.Faces.GetFaceVertices(faceIndex))
                    if EPConstruction!=None: thisShading.EPConstruction = EPConstruction
                    if RADConstruction!=None: thisShading.RadMaterial = getRadMaterialName(RADConstruction)
                    shadingClasses.append(thisShading)
                    # shadingMeshPreview.append(thisShading.meshedFace)
                    brepFaceIndex += 1
        
        # add to the hive
        hb_hive = sc.sticky["honeybee_Hive"]()
        HBContext  = hb_hive.addToHoneybeeHive(shadingClasses, ghenv.Component.InstanceGuid.ToString())
        return HBContext
        ################################################################################################
    else:
        print "You should first let both Ladybug and Honeybee to fly..."
        w = gh.GH_RuntimeMessageLevel.Warning
        ghenv.Component.AddRuntimeMessage(w, "You should first let both Ladybug and Honeybee to fly...")
        return -1
        

if shdSurfaces and shdSurfaces[0]!=None:
    # add cleaning function
    result= main()
    
    if result != -1: HBContext = result
# ---------- end hb_epcontextsrf ----------
runenergysimulation = Honeybee_RunEnergySimulation(
    epwFile=open_epw_stat.epwFile,
    HBZones=flatten(setepzonecnstr),
    HBContext=flatten(hb_epcontextsrf.HBContext),
    simulationOutputs=flatten(writeresultparameters.simulationOutputs),
    writeIdf=Toggle(True),
    runEnergyPlus=Toggle(True),
    meshingLevel=1)  # -> report, idfFileAddress, resultFileAddress; plug-in component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
preview_3 = CustomPreview(Geometry=shddesigner.shadingSrfs, Shader=ColourSwatch(SwatchColor=RGBA(204, 204, 204, 226)))
preview_4 = CustomPreview(Geometry=decomposebytype.walls, Shader=ColourSwatch(SwatchColor=RGBA(255, 255, 120, 226)))
preview_5 = CustomPreview(Geometry=decomposebytype.windows, Shader=ColourSwatch(SwatchColor=RGBA(120, 226, 255, 116)))
preview_6 = CustomPreview(Geometry=decomposebytype.roofs, Shader=ColourSwatch(SwatchColor=RGBA(89, 89, 89, 226)))
preview_7 = CustomPreview(Geometry=decomposebytype.floors, Shader=ColourSwatch(SwatchColor=RGBA(230, 129, 129, 226)))
readidf = Honeybee_ReadEPResult(resultFileAddress=runenergysimulation.resultFileAddress)  # -> report, port, simplify(zoneHeating), zoneCooling, zoneElectricLight, zoneElectricEquip, port_2, zonePeopleGains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; plug-in component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
data = Data(flatten(readidf.zoneAirTemperature))
data_2 = Data(flatten(readidf.zoneMeanRadiantTemperature))
pmvcomfortcalculator = Ladybug_PMVComfortCalculator(
    dryBulbTemperature=readidf.zoneAirTemperature,
    meanRadiantTemperature=readidf.zoneMeanRadiantTemperature,
    relativeHumidity=separatedata.numbers,
    eightyPercentComfortable=True,
    calcBalanceTemperature=False,
    runIt=Toggle(True))  # -> readMe, port, predictedMeanVote, percentPeopleDissatisfied, standardEffectiveTemperature, port_2, comfortableOrNot, percentOfTimeComfortable, port_3, balanceTemperature; plug-in component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

ma = MassAddition(Input=[readidf.zoneHeating, readidf.zoneCooling])  # -> flatten(Result), PartialResults
brep_2 = Brep(mass2zone.HBZones)
sort = SortList(Keys=ma.Result)  # -> Keys, ValuesA
rev = ReverseList(List=sort.Keys)
pt_3 = ConstructPoint(XCoordinate=200, YCoordinate=0, ZCoordinate=0)
item_2 = ListItem(List=rev, Index=0, Wrap=True)
item_3 = ListItem(List=sort.Keys, Index=0, Wrap=True)
move_2 = Move(Geometry=brep_2, Motion=pt_3)  # -> Geometry, Transform
gradient = Gradient(
    LowerLimit=item_3,
    UpperLimit=item_2,
    Parameter=ma.Result,
    stops=[0: RGBA(235, 39, 0, 200), 0.25: RGBA(235, 125, 0, 207), 0.5: RGBA(255, 244, 84, 198), 0.75: RGBA(172, 203, 250, 198), 1: RGBA(74, 105, 168, 200)])
preview_8 = CustomPreview(Geometry=move_2.Geometry, Shader=gradient)

data_3 = Data(flatten(pmvcomfortcalculator.percentOfTimeComfortable))
subtraction_2 = Subtraction(A=100, B=data_3)

brep_3 = Brep(mass2zone.HBZones)
sort_2 = SortList(Keys=subtraction_2)  # -> Keys, ValuesA
rev_2 = ReverseList(List=sort_2.Keys)
pt_4 = ConstructPoint(XCoordinate=200, YCoordinate=200, ZCoordinate=0)
item_4 = ListItem(List=rev_2, Index=0, Wrap=True)
item_5 = ListItem(List=sort_2.Keys, Index=0, Wrap=True)
move_3 = Move(Geometry=brep_3, Motion=pt_4)  # -> Geometry, Transform
gradient_2 = Gradient(
    LowerLimit=item_5,
    UpperLimit=item_4,
    Parameter=subtraction_2,
    stops=[0: RGBA(235, 39, 0, 200), 0.25: RGBA(235, 125, 0, 207), 0.5: RGBA(255, 244, 84, 198), 0.75: RGBA(172, 203, 250, 198), 1: RGBA(74, 105, 168, 200)])
preview_9 = CustomPreview(Geometry=move_3.Geometry, Shader=gradient_2)

avr = Average(Input=data_3)
ma_2 = MassAddition(Input=flatten(readidf.zoneHeating))  # -> Result, PartialResults
ma_3 = MassAddition(Input=flatten(readidf.zoneCooling))  # -> Result, PartialResults
addition_2 = Addition(A=ma_2.Result, B=ma_3.Result)
subtraction_3 = Subtraction(A=100, B=avr)
multiplication_3 = Multiplication(A=subtraction_3, B=10000)
addition_3 = Addition(A=addition_2, B=multiplication_3)
total_heating = Panel(ma_2.Result)
total_cooling = Panel(ma_3.Result)
percent_of_time_uncomfortable = Panel(subtraction_3)
fittness = Panel(addition_3)
total_thermal_energy = Panel(addition_2)
bbox = BoundingBox(Content=move_2.Geometry, Plane=PlaneXY(0, 0, 0), UnionBox=True)  # -> Box, Box_2
box = EvaluateBox(Box=bbox.Box, UParameter=0.5, VParameter=0.5, WParameter=0.5)  # -> Plane, Point, Include
neg_2 = Negative(Value=box.Point)
move_4 = Move(Geometry=move_2.Geometry, Motion=neg_2)  # -> graft(Geometry), Transform
mcol = MeshColours(Mesh=move_4.Geometry, Colours=graft(gradient))
bbox_2 = BoundingBox(Content=move_3.Geometry, Plane=PlaneXY(0, 0, 0), UnionBox=True)  # -> Box, Box_2
number_slider = Slider(259, range=0..1000)
box_2 = EvaluateBox(Box=bbox_2.Box, UParameter=0.5, VParameter=0.5, WParameter=0.5)  # -> Plane, Point, Include
mjoin = MeshJoin(Meshes=flatten(mcol))
pt_5 = ConstructPoint(XCoordinate=Slider(359, range=0..1000), YCoordinate=Slider(471, range=0..1000), ZCoordinate=0)
neg_3 = Negative(Value=box_2.Point)
move_5 = Move(Geometry=move_3.Geometry, Motion=neg_3)  # -> graft(Geometry), Transform
pt_6 = ConstructPoint(XCoordinate=number_slider, YCoordinate=Slider(801, range=0..1000), ZCoordinate=0)
number_slider_2 = Slider(9, range=0..10)
mcol_2 = MeshColours(Mesh=move_5.Geometry, Colours=graft(gradient_2))
number_slider_3 = Slider(46, range=0..100)
pt_7 = ConstructPoint(XCoordinate=number_slider, YCoordinate=Slider(253, range=0..1000), ZCoordinate=0)
number_slider_4 = Slider(13, range=0..100)
mjoin_2 = MeshJoin(Meshes=flatten(mcol_2))
pt_8 = ConstructPoint(XCoordinate=Slider(359, range=0..1000), YCoordinate=Slider(981, range=0..1000), ZCoordinate=0)
texttoscreen = RenderTextToScreen(Text="Uncomfortable Hours", Location=pt_6, Size=number_slider_3, Color=RGB(0, 0, 0), m_scWithvp=False)
number_slider_5 = Slider(9, range=0..10)
texttoscreen_2 = RenderTextToScreen(Text="Heating/Cooling", Location=pt_7, Size=number_slider_3, Color=RGB(0, 0, 0), m_scWithvp=False)
meshtoscreen = RenderMeshToScreen(Mesh=mjoin, Location=pt_5, ScaleFactor=number_slider_4, Depth=0.95, Fixed=False, m_scWithvp=False)
meshtoscreen_2 = RenderMeshToScreen(Mesh=mjoin_2, Location=pt_8, ScaleFactor=number_slider_4, Depth=0.95, Fixed=False, m_scWithvp=False)
